# Dynamo graph BIM代码.dyn "shiyan-路面层实体" (Dynamo 2.0.2.6826)

file_path = Filename("..\横断面\A匝道横断面.xlsx")
file_from_path = FileObject(path=file_path)
code_block = CodeBlock { "A匝道"; }
importExcel = Data.ImportExcel(file=file_from_path, sheetName=code_block)
transpose = List.Transpose(lists=importExcel)
code_block_2 = CodeBlock(a=transpose)
# ---------- code_block_2.designscript (4 lines) ----------
//编号
a[0];
//0/1
a[4];
# ----------------------------------------
code_block_3 = CodeBlock(a=transpose)
# ---------- code_block_3.designscript (4 lines) ----------
//编号
a[0];
//0/1
a[7];
# ----------------------------------------
# note: @好丑dynamo
# Email：haochou_dynamo@yeah.net
# 微信公众号：好丑dynamo
# 知乎：好丑dynamo
file_path_2 = Filename("..\路线\互通A.xlsx")
code_block_4 = CodeBlock { 3243624.4124; 492267.2217; 310.788; }
centerLineByPoints = Custom[Control.CenterLineByPoints](filePath=file_path_2, originX=code_block_4.out0, originY=code_block_4.out1, originZ=code_block_4.out2)
restOfItems = List.RestOfItems(list=transpose@L2)
code_block_5 = CodeBlock(a=restOfItems)
# ---------- code_block_5.designscript (2 lines) ----------
//桩号
a[1];
# ----------------------------------------
toNumber = String.ToNumber(str=code_block_5)
control_3d_curvechainagepoint = Custom[Control.3D CurveChainagePoint](centerLineBy3D=centerLineByPoints.3D_CenterLine, centerLineBy2D=centerLineByPoints.2D_CenterLine, chainage=toNumber)
control_degreeat3d = Custom[Control.DegreeAt3D CenterlineChainage](points=control_3d_curvechainagepoint)
family_types = FamilyTypes(index=31)
familyInstanceByPointAndRotation = Custom[Control.FamilyInstanceByPointAndRotation](points=control_degreeat3d.FamilyInstance_points, degree=control_degreeat3d.Degree, familyType=family_types)
code_block_6 = CodeBlock(a=transpose)
# ---------- code_block_6.designscript (4 lines) ----------
//Wz
a[2];
//横坡
a[3];
# ----------------------------------------
list_create = List.Create(item0=code_block_6.out0, item1=code_block_6.out1)
elementSetParameterByName = Custom[Control.ElementSetParameterByName](element=familyInstanceByPointAndRotation, value=list_create)
code_block_7 = CodeBlock(a=transpose) { a[0]; }
code_block_8 = CodeBlock(a=transpose) { a[4]; }
isMirrorGeometry = Custom[Control.IsMirrorGeometry](element=elementSetParameterByName, MirrorPlaneOrigin=control_degreeat3d.FamilyInstance_points, isTorF=code_block_7, index=code_block_8)
code_block_9 = CodeBlock()
# ---------- code_block_9.designscript (2 lines) ----------
//路面层厚度
0.3;
# ----------------------------------------
createThickenAndGetPerimeterCurves = Custom[Control.CreateThickenAndGetPerimeterCurves](curves=isMirrorGeometry, offsetDouble=code_block_9)
joinCurves = Custom[Control.JoinCurves](curves=createThickenAndGetPerimeterCurves)
control_list_flattem = Custom[Control.List Flattem](list=joinCurves)
getEveryOtherIndex = Custom[Control.GetEveryOtherIndex](list=control_list_flattem)
splitByPoints = Curve.SplitByPoints(curve=control_degreeat3d.3D_Centerline, points=control_degreeat3d.FamilyInstance_points)
control_list_flattem_2 = Custom[Control.List Flattem](list=splitByPoints@L1)
byLoft = Solid.ByLoft(crossSections=getEveryOtherIndex.lists, guideCurves=control_list_flattem_2)
family_types_2 = FamilyTypes(index=27)
familyInstanceByPointAndRotation_2 = Custom[Control.FamilyInstanceByPointAndRotation](points=control_degreeat3d.FamilyInstance_points, degree=control_degreeat3d.Degree, familyType=family_types_2)
code_block_10 = CodeBlock(a=transpose)
# ---------- code_block_10.designscript (4 lines) ----------
//Wy
a[5];
//横坡
a[6];
# ----------------------------------------
list_create_2 = List.Create(item0=code_block_10.out0, item1=code_block_10.out1)
elementSetParameterByName_2 = Custom[Control.ElementSetParameterByName](element=familyInstanceByPointAndRotation_2, value=list_create_2)
code_block_11 = CodeBlock(a=transpose) { a[0]; }
code_block_12 = CodeBlock(a=transpose) { a[7]; }
isMirrorGeometry_2 = Custom[Control.IsMirrorGeometry](element=elementSetParameterByName_2, MirrorPlaneOrigin=control_degreeat3d.FamilyInstance_points, isTorF=code_block_11, index=code_block_12)
createThickenAndGetPerimeterCurves_2 = Custom[Control.CreateThickenAndGetPerimeterCurves](curves=isMirrorGeometry_2, offsetDouble=code_block_9)
joinCurves_2 = Custom[Control.JoinCurves](curves=createThickenAndGetPerimeterCurves_2)
control_list_flattem_3 = Custom[Control.List Flattem](list=joinCurves_2)
getEveryOtherIndex_2 = Custom[Control.GetEveryOtherIndex](list=control_list_flattem_3)
byLoft_2 = Solid.ByLoft(crossSections=getEveryOtherIndex_2.lists, guideCurves=control_list_flattem_2)
list_create_3 = List.Create(item0=byLoft, item1=byLoft_2)
control_list_flattem_4 = Custom[Control.List Flattem](list=list_create_3)
byUnion = Solid.ByUnion(solids=control_list_flattem_4)
file_path_3 = Filename("C:\ProgramData\Autodesk\RVT 2018\Family Templates\Chinese\公制常规模型.rft")
code_block_13 = CodeBlock { "好丑dynamo_A匝道路面"; }
# note: From Springs package
byGeometry = Custom[Springs.FamilyInstance.ByGeometry](geometry=byUnion, familyTemplatePath=file_path_3, familyName=code_block_13)  # You must provide a valid family template path that will be used for all input geometry objects. The project units(and not the templates) will be used to determine the size of the output geometry. The provided category will be used only if the family template supports it. If not, the default template category will be used instead. Likewise, the family material(provided as a string) will be set only if a material with that name exists in the template. If not, the default material will be used instead ("By Category"). For void cuts, the material settings will be ignored. The Subcategory name is an optional input. If you'd like to skip assigning a Subcategory to any new instance, simply use null. The node expects a unique family name for each geometry object. The rest of the input lists will be processed as if the node lacing is set to longest.
code_block_14 = CodeBlock()
# ---------- code_block_14.designscript (10 lines) ----------
//达到Solid.ByLoft时
//代表已经在dynamo中以完成路面层实体创建
//此时可以根据伸缩缝、施工缝等
//对路面长度进行划分
//确定构件单元名称
//便于BIM模型构件的管理
//实现在BIM项目管理平台上的使用
//后期会推出相关内容
//包括有模型拆分、构件命名规则、构件编码等
//也同时包含批量挂接图纸信息等多种较为实用的功能
# ----------------------------------------
